# Grasshopper definition keycap.gh (Grasshopper 0.9.80)

cross_height = Slider(4.04, range=0..5)
offset = Slider(0.016, range=0..1)
width = Slider(18, range=0..20)
top_thickness = Slider(-1.5, range=-5..-1)
top = Geometry(<curve referenced from the Rhino model>)
cross = Geometry(<curve referenced from the Rhino model>)
patch = Patch(Curves=cross, Spans=20, Flexibility=1, Trim=True)
offset_l = OffsetLoose(Curve=cross, Distance=offset)
scale = Scale(Geometry=top, Center=Point(0, 0, 0), Factor=width)  # -> Geometry, Transform
box = Box(offset_l)
fillet = Fillet(Curve=scale.Geometry, Radius=Slider(7.4, range=0..10))
Z = UnitZ(Factor=cross_height)
extr = Extrude(Base=patch, Direction=Z)
Z_2 = UnitZ(Factor=cross_height)
extr_2 = Extrude(Base=box, Direction=Z_2)
patch_2 = Patch(Curves=fillet, Spans=20, Flexibility=1, Trim=True)
Z_3 = UnitZ(Factor=top_thickness)
extr_3 = Extrude(Base=patch_2, Direction=Z_3)
sdiff = SolidDifference(BrepsA=extr_2, BrepsB=extr)
keycap = Geometry([sdiff, extr_3])
